# Grasshopper definition scanGenerator-rectangular.gh (Grasshopper 0.9.76)
# plug-ins: Python Interpreter, BullAnt

number_slider = Slider(15, range=0..180)
expression = Expression(d=number_slider, Expression="round(180/d)")
expression_2 = Expression(d=number_slider, Expression="round(360/d)")
xy = XYPlane(Origin=Point(0, 0, 0))
series = Series(Start=0, Step=expr("1/(x-1)", expression_2), Count=expression_2)
series_2 = Series(Start=0, Step=expr("1/(x-1)", expression), Count=expression)
xy_2 = XYPlane(Origin=Point(0, 0, 0))
sph = Sphere(Base=PlaneXY(0, 0, 0), Radius=Slider(10.1, range=0..100))
expression_3 = Expression(x=series, y=graft(series_2), Expression="Format(\"{0}, {1}\", x, y)")
gggd = GgGeoDome(
    Origin=xy,
    Radius=Slider(10, range=0..10),
    Class=0,
    Bucky=Toggle(False),
    Freq=Slider(10, range=0..10),
    Lines=False,
    BuckyCL=1)  # disabled
cp = ControlPoints(Curve=gggd)  # -> Points, Weights, Knots
evalsrf = EvaluateSurface(Surface=reparameterize(sph), Point=expression_3)  # -> Point, Normal, Frame
data = Data(evalsrf.Point)
cullpt = CullDuplicates(Points=flatten(data), Tolerance=Slider(0.01, range=0..0.01), CullMode=3)  # -> Points, Indices, Valence
data_2 = Data(data)
item = ListItem(List=data_2, Index=[0, 1], Wrap=True)  # disabled
ln = Line(StartPoint=item, EndPoint=xy_2)
frame = CurveFrame(Curve=ln, Parameter=0.01)
len = Length(Curve=ln)
deplane = DeconstructPlane(Plane=frame)  # -> Origin, XAxis, YAxis, ZAxis
expression_4 = Expression(l=len, Expression="l*tan(rad(5))")
pl = ConstructPlane(Origin=deplane.Origin, XAxis=deplane.YAxis, YAxis=deplane.ZAxis)
tstat = TreeStatistics(Tree=data_2)  # -> Paths, Length, Count
cone = Cone(Base=pl, Radius=expression_4, Length=len)  # -> Cone, Tip
panel = Panel(tstat.Length)
polar = ToPolar(Point=data_2, System=PlaneXY(0, 0, 0))  # -> simplify(Phi), simplify(Theta), Radius
entwine = Entwine(Branch00=polar.Phi, Branch01=polar.Theta, FlattenInputs=True)
flatten = FlattenTree(Tree=data_2, Path="{0}")
flip = FlipMatrix(Data=entwine)
panel_2 = Panel(flip)
panel_3 = Panel(entwine)
deg = Degrees(Radians=flip)
round = Round(Number=deg)  # -> Nearest, Floor, Ceiling
flip_2 = FlipMatrix()
deg_2 = Degrees(Radians=flip_2)
flip_3 = FlipMatrix(Data=round.Nearest)
bang = ExplodeTree(Data=flip_3)  # -> Branch0, Branch1
toggle = BooleanToggle(True)
panel_4 = Panel(deg_2)
expression_5 = Expression(x=bang.Branch0, y=bang.Branch1, Expression="Format(\"{0},{1}\", x, y)")  # -> simplify(flatten(R))
tag = TextTag3D(Location=flatten, Text=expression_5, Size=Slider(0.41, range=0..1), Justification=1)
python = FileCreator(name="ghScan", ext="json", lines=expression_5, write=Button())  # -> out, a; inputs lines: list
# ---------- python: Python ----------
"""
Creates a file with a given ndame and extension.
    Inputs:
        name: Desired file name.
        ext: Desired file extension.
        lines: Text to write.
        write: Set to True to write.
"""

# Stephen P. Maher /  2015

ghenv.Component.Name = "File Creator"

import Grasshopper as gh
import os

gh_path = ghdoc.Path # Get GH file path
file = "D:/Dropbox/01 Large Projects/smartSensor/chaosGit/scanParams/scanPoints.json"
#os.path.dirname(os.path.realpath(gh_path)) # Get GH file directory to save to

#if "." not in ext: ext = "." + ext
#else: pass

#if os.path.exists(file) == False: # Test if file already exists; if it doesn't, proceed
#    file = name + ext # Set file name and extension
#if os.path.exists(file) == True: # If it does exists, follow the next steps
#    file_count = len([f for f in os.walk(".").next()[2] if f[-4:] == ext]) # Find all files with the same extension
#    file = name + "_" + str(file_count) + ext # Add the number to the new file name as a differentiator

if write:
    output = open(file, "w") # Open the file
    output.write('[\n')
    for line in lines:
        line = line.strip()
        angles = line.split(',');
        output.write('{' + '"a": ' + angles[0] + ',"b": ' + angles[1] + '},\n')
    output.write(']')
    output.close()

else:
    msg = "Set 'write' to True."
    ghenv.Component.AddRuntimeMessage(gh.Kernel.GH_RuntimeMessageLevel.Warning, msg)
# ---------- end python ----------
panel_5 = Panel(expression_5)
