# Grasshopper definition scanGenerator.gh (Grasshopper 0.9.76)
# plug-ins: Python Interpreter, BullAnt

xy = XYPlane(Origin=Point(0, 0, 0))
xy_2 = XYPlane(Origin=Point(0, 0, 0))
gggd = GgGeoDome(
    Origin=xy_2,
    Radius=Slider(10, range=0..10),
    Class=0,
    Bucky=Toggle(False),
    Freq=Slider(6, range=0..32),
    Lines=False,
    BuckyCL=1)
cp = ControlPoints(Curve=gggd)  # -> Points, Weights, Knots
number_slider = Slider(1, range=0..180)
cullpt = CullDuplicates(Points=flatten(cp.Points), Tolerance=Slider(0.01, range=0..0.01), CullMode=3)  # -> Points, Indices, Valence
item = ListItem(List=cullpt.Points, Index=[0, 1], Wrap=True)
ln = Line(StartPoint=item, EndPoint=xy)
frame = CurveFrame(Curve=ln, Parameter=0.01)
len = Length(Curve=ln)
deplane = DeconstructPlane(Plane=frame)  # -> Origin, XAxis, YAxis, ZAxis
expression = Expression(l=len, Expression="l*tan(rad(0.2))")
pl = ConstructPlane(Origin=deplane.Origin, XAxis=deplane.YAxis, YAxis=deplane.ZAxis)
tstat = TreeStatistics(Tree=cullpt.Points)  # -> Paths, Length, Count
cone = Cone(Base=pl, Radius=expression, Length=len)  # -> Cone, Tip
panel = Panel(tstat.Length)
expression_2 = Expression(d=number_slider, Expression="round(180/d)+1")
expression_3 = Expression(d=number_slider, Expression="round(360/d)")
polar = ToPolar(Point=cullpt.Points, System=PlaneXY(0, 0, 0))  # -> Phi, Theta, Radius
entwine = Entwine(Branch00=polar.Phi, Branch01=polar.Theta, FlattenInputs=True)
series = Series(Start=-90, Step=number_slider, Count=expression_2)
series_2 = Series(Start=0, Step=number_slider, Count=expression_3)
expression_4 = Expression(x=graft(series_2), y=series, Expression="Format(\"{0}, {1}\", x, y)")  # -> simplify(flatten(R))
deg = Degrees(Radians=entwine)
flip = FlipMatrix(Data=entwine)
round = Round(Number=deg)  # -> Nearest, Floor, Ceiling
deg_2 = Degrees(Radians=flip)
bang = ExplodeTree(Data=deg)  # -> Branch0, Branch1
panel_2 = Panel(deg)
panel_3 = Panel(deg_2)
panel_4 = Panel(expression_4)
expression_5 = Expression(x=bang.Branch0, y=bang.Branch1, Expression="Format(\"{0},{1}\", x, y)")
tag = TextTag3D(Location=cullpt.Points, Text=expression_5, Size=Slider(0.41, range=0..1), Justification=1)
toggle = BooleanToggle(True)
panel_5 = Panel(expression_5)
python = FileCreator(name="ghScan", ext="json", lines=expression_4, write=Button())  # -> out, a; inputs lines: list
# ---------- python: Python ----------
"""
Creates a file with a given ndame and extension.
    Inputs:
        name: Desired file name.
        ext: Desired file extension.
        lines: Text to write.
        write: Set to True to write.
"""

# Stephen P. Maher /  2015

ghenv.Component.Name = "File Creator"

import Grasshopper as gh
import os

gh_path = ghdoc.Path # Get GH file path
file = "C:/Dropbox/01 Large Projects/smartSensor/chaosGit/scanParams/scanPoints.json"
#os.path.dirname(os.path.realpath(gh_path)) # Get GH file directory to save to

#if "." not in ext: ext = "." + ext
#else: pass

#if os.path.exists(file) == False: # Test if file already exists; if it doesn't, proceed
#    file = name + ext # Set file name and extension
#if os.path.exists(file) == True: # If it does exists, follow the next steps
#    file_count = len([f for f in os.walk(".").next()[2] if f[-4:] == ext]) # Find all files with the same extension
#    file = name + "_" + str(file_count) + ext # Add the number to the new file name as a differentiator

if write:
    output = open(file, "w") # Open the file
    output.write('[\n')
    for line in lines:
        line = line.strip()
        angles = line.split(',');
        output.write('{' + '"a": ' + angles[0] + ',"b": ' + angles[1] + '},\n')
    output.write(']')
    output.close()

else:
    msg = "Set 'write' to True."
    ghenv.Component.AddRuntimeMessage(gh.Kernel.GH_RuntimeMessageLevel.Warning, msg)
# ---------- end python ----------
